# Grasshopper definition sMT_bakeLayers.gh (Grasshopper 0.9.56)

crv = Curve([<curve referenced from the Rhino model> x4])
Y = UnitY(Factor="12")
move = Move(Geometry=crv, Motion=Y)  # -> Geometry, Transform
path_mapper = PathMapper(move.Geometry, source="{A}", target="{A+1}")
merge = Merge(Data1=crv, Data2=path_mapper)
Z = UnitZ(Factor=Slider(2, range=1..120))
move_2 = Move(Geometry=merge, Motion=Z)  # -> Geometry, Transform
bake = BooleanToggle(False)
smt_export = CSharpScript(toolPaths=merge, refPaths=move_2.Geometry, activate=bake)  # -> out; inputs toolPaths: tree of Curve, refPaths: tree of Curve, activate: Boolean
# ---------- smt_export: C# ----------
    //C# script component by Aaron Willette
    //references 'bakeAttributes' by Giulio Piacentino
    
    if (activate)
    {
      //TOOLPATH TREE IS THE PRIMARY TREE
      if (toolPaths.BranchCount < refPaths.BranchCount)
      {
        Print("ERROR: More reference path branches than tool path branches. Last reference path branch will be ignored");
      }

      //CREATE 'sMT_IMPORT' LAYER
      const string rootLayer = "sMT_IMPORT";
      createLayer(rootLayer, null);

      // ASSIGN TO LAYERS
      string layer;
      int j;
      for(int i = 0; i < toolPaths.BranchCount; i++)
      {
        layer = string.Format("{0}_Operation", i);

        //TOOL PATHS
        j = 0;
        toolPaths.Branch(i).ForEach(delegate(Curve geoPath)
          {
            if (geoPath == null)
            {
              Print("No toolPath to bake");
            }

            Rhino.DocObjects.ObjectAttributes att = new Rhino.DocObjects.ObjectAttributes();
            att.Name = string.Format("{0}_Toolpath", j++);
            att.LayerIndex = createLayer(layer, rootLayer);
            doc.Objects.AddCurve(geoPath as Curve, att);
          });

        //REFERENCE PATHS
        j = 0;
        refPaths.Branch(i).ForEach(delegate(Curve geoPath)
          {
            if(geoPath == null)
            {
              Print("No refPath to bake");
            }

            Rhino.DocObjects.ObjectAttributes att = new Rhino.DocObjects.ObjectAttributes();
            att.Name = string.Format("{0}_Reference", j++);
            att.LayerIndex = createLayer(layer, rootLayer);
            doc.Objects.AddCurve(geoPath as Curve, att);
          });
      }
    }
# ---------- smt_export: C# additional code ----------
  private int createLayer(string layerName, string parentName)
  {
    Rhino.DocObjects.Tables.LayerTable layerTable = doc.Layers;
    int layerIndex = layerTable.Find(layerName, true);


    if(layerIndex < 0) //if layer doesn't exist
    {
      Rhino.DocObjects.Layer newLayer = new Rhino.DocObjects.Layer();
      newLayer.Name = layerName;

      if (!String.IsNullOrEmpty(parentName))
      {
        newLayer.ParentLayerId = layerTable[layerTable.Find(parentName, true)].Id;
      }

      layerIndex = layerTable.Add(newLayer);

      if(layerIndex > -1)
      {
        Print("New layer added to the document.");
      } else
        Print("Layer did not add.");
    }
    else //if layer does exist
    {
      Rhino.DocObjects.Layer newLayer = layerTable[layerIndex];
      newLayer.CommitChanges();
      Print("Existing layer used.");
    }

    return layerIndex;
  }
# ---------- end smt_export ----------
panel = Panel(smt_export)
